# Grasshopper definition class_example.gh (Grasshopper 1.0.7)

rect_hight = Slider(10, range=0..100)
rect_width = Slider(3.756, range=3.5..4.5)
circle_rad = Slider(30, range=0..100)
negative_two = Number(-2)
square = Square(Value=circle_rad)
rectangle = Rectangle(Plane=PlaneXY(0, 0, 0), XSize=rect_width, YSize=rect_hight, Radius=0)  # -> Rectangle, Length
subtraction = Subtraction(A=circle_rad, B=rect_hight)
division = Division(A=rect_width, B=negative_two)
square_2 = Square(Value=division)
addition = Addition(A=division, B=rect_width)
subtraction_2 = Subtraction(A=square, B=square_2)
square_root = SquareRoot(Value=subtraction_2)
cuts = Slider(8, range=0..10)
vector_xyz = VectorXYZ(XComponent=division, YComponent=subtraction, ZComponent=0)  # -> Vector, Length
construct_point = ConstructPoint(XCoordinate=addition, YCoordinate=square_root, ZCoordinate=0)
move = Move(Geometry=rectangle.Rectangle, Motion=vector_xyz.Vector)  # -> Geometry, Transform
circle_center = Point(Point(0, 0, 0))
construct_point_2 = ConstructPoint(XCoordinate=division, YCoordinate=square_root, ZCoordinate=0)
circle_cnr = CircleCNR(Center=circle_center, Normal=Vector(0, 0, 1), Radius=circle_rad)
blade = Slider(42, range=0..300)
polar_array = PolarArray(Geometry=move.Geometry, Plane=PlaneXY(0, 0, 0), Count=cuts, Angle=6.283185307)  # -> Geometry, Transform
pi = Number(-3.141593)
number = Number(-1)
division_2 = Division(A=pi, B=cuts)
number_2 = Number(3.141592653)
number_3 = Number(1.570796)
trim_with_regions = TrimWithRegions(Curve=polar_array.Geometry, Regions=circle_cnr)  # -> Inside, Outside
trim_with_regions_2 = TrimWithRegions(Curve=circle_cnr, Regions=polar_array.Geometry)  # -> Inside, Outside
addition_2 = Addition(A=division_2, B=number_3)
multiplication = Multiplication(A=addition_2, B=number)
addition_3 = Addition(A=multiplication, B=number_2)
point_polar = PointPolar(BasePlane=PlaneXY(0, 0, 0), XYAngle=addition_2, ZAngle=0, Offset=blade)
trim_with_regions_3 = TrimWithRegions(Curve=trim_with_regions.Inside, Regions=trim_with_regions_2.Outside)  # -> Inside, Outside
point_polar_2 = PointPolar(BasePlane=PlaneXY(0, 0, 0), XYAngle=addition_3, ZAngle=0, Offset=blade)
interpolate = Interpolate(Vertices=[point_polar, construct_point], Degree=3, Periodic=False, KnotStyle=1)  # -> Curve, Length, Domain
interpolate_2 = Interpolate(Vertices=[construct_point_2, point_polar_2], Degree=3, Periodic=False, KnotStyle=1)  # -> Curve, Length, Domain
polar_array_2 = PolarArray(Geometry=[interpolate_2.Curve, interpolate.Curve], Plane=PlaneXY(0, 0, 0), Count=cuts, Angle=6.283185307)  # -> Geometry, Transform
join_curves = JoinCurves(Curves=[trim_with_regions_3.Inside, polar_array_2.Geometry, trim_with_regions_3.Outside], Preserve=False)
