# Grasshopper definition assignment4.gh (Grasshopper 1.0.7)

piece_size = Slider(35, range=5..50)
nubs_per_side = Slider(4, range=0..10)
one = Number(1)
rectangle = Rectangle(Plane=PlaneXY(0, 0, 0), XSize=piece_size, YSize=piece_size, Radius=0)  # -> Rectangle, Length
tolerances = Slider(0.14, range=0..0.3)
subtraction = Subtraction(A=nubs_per_side, B=one)
negative_two = Number(-2)
addition = Addition(A=nubs_per_side, B=subtraction)
negative_one = Number(-1)
two = Number(2)
division = Division(A=piece_size, B=negative_two)
vector_xyz = VectorXYZ(XComponent=division, YComponent=division, ZComponent=0)  # -> Vector, Length
division_2 = Division(A=tolerances, B=two)
subtraction_2 = Subtraction(A=division, B=division_2)
nub_size = Division(A=piece_size, B=addition)
multiplication = Multiplication(A=piece_size, B=negative_one)
multiplication_2 = Multiplication(A=division, B=negative_one)
subtraction_3 = Subtraction(A=nub_size, B=tolerances)
addition_2 = Addition(A=division_2, B=division)
subtraction_4 = Subtraction(A=division, B=nub_size)
multiplication_3 = Multiplication(A=division, B=negative_one)
subtraction_5 = Subtraction(A=division, B=nub_size)
multiplication_4 = Multiplication(A=nub_size, B=two)
addition_3 = Addition(A=subtraction_3, B=tolerances)
rectangle_2 = Rectangle(Plane=PlaneXY(0, 0, 0), XSize=subtraction_3, YSize=nub_size, Radius=0)  # -> Rectangle, Length
rectangle_3 = Rectangle(Plane=PlaneXY(0, 0, 0), XSize=nub_size, YSize=subtraction_3, Radius=0)  # -> Rectangle, Length
unit_y = UnitY(Factor=multiplication_4)
vector_top = VectorXYZ(XComponent=addition_2, YComponent=multiplication_2, ZComponent=0)  # -> VectorTo, Length
unit_x = UnitX(Factor=multiplication_4)
linear_array = LinearArray(Geometry=rectangle_3.Rectangle, Direction=unit_y, Count=subtraction)  # -> Geometry, Transform
vector_right = VectorXYZ(XComponent=multiplication_3, YComponent=addition_2, ZComponent=0)  # -> Vector, Length
vector_bottom = VectorXYZ(XComponent=addition_2, YComponent=subtraction_5, ZComponent=0)  # -> Vector, Length
vector_xyz_2 = VectorXYZ(XComponent=0, YComponent=addition_3, ZComponent=0)  # -> Vector, Length
linear_array_2 = LinearArray(Geometry=rectangle_2.Rectangle, Direction=unit_x, Count=subtraction)  # -> Geometry, Transform
vector_xyz_3 = VectorXYZ(XComponent=nub_size, YComponent=0, ZComponent=0)  # -> Vector, Length
vector_left = VectorXYZ(XComponent=subtraction_4, YComponent=addition_2, ZComponent=0)  # -> Vector, Length
side_side = LinearArray(Geometry=rectangle_2.Rectangle, Direction=unit_x, Count=nubs_per_side)  # -> Geometry, Transform
up_down = LinearArray(Geometry=rectangle_3.Rectangle, Direction=unit_y, Count=nubs_per_side)  # -> Geometry, Transform
inverse_side = Move(Geometry=linear_array_2.Geometry, Motion=vector_xyz_3.Vector)  # -> Geometry, Transform
inverse_up = Move(Geometry=linear_array.Geometry, Motion=vector_xyz_2.Vector)  # -> Geometry, Transform
move_right = Move(Geometry=up_down.Geometry, Motion=vector_right.Vector)  # -> Geometry, Transform
move_rec = Move(Geometry=rectangle.Rectangle, Motion=vector_xyz.Vector)  # -> Geometry, Transform
inverse_left = Move(Geometry=inverse_up.Geometry, Motion=vector_left.Vector)  # -> Geometry, Transform
move_top = Move(Geometry=side_side.Geometry, Motion=vector_top.VectorTo)  # -> Geometry, Transform
move_bot = Move(Geometry=side_side.Geometry, Motion=vector_bottom.Vector)  # -> Geometry, Transform
move_left = Move(Geometry=up_down.Geometry, Motion=vector_left.Vector)  # -> Geometry, Transform
inverse_right = Move(Geometry=inverse_up.Geometry, Motion=vector_right.Vector)  # -> Geometry, Transform
inverse_top = Move(Geometry=inverse_side.Geometry, Motion=vector_top.VectorTo)  # -> Geometry, Transform
inverse_bot = Move(Geometry=inverse_side.Geometry, Motion=vector_bottom.Vector)  # -> Geometry, Transform
join_curves = JoinCurves(
    Curves=[move_rec.Geometry, move_right.Geometry, move_left.Geometry, move_bot.Geometry, move_top.Geometry],
    Preserve=False)
curve_curve = CurveCurve(CurveA=inverse_bot.Geometry, CurveB=move_rec.Geometry)  # -> Points, ParamsA, ParamsB
curve_curve_2 = CurveCurve(CurveA=inverse_right.Geometry, CurveB=move_rec.Geometry)  # -> Points, ParamsA, ParamsB
join_curves_2 = JoinCurves(
    Curves=[move_rec.Geometry, inverse_left.Geometry, inverse_right.Geometry, inverse_top.Geometry, inverse_bot.Geometry],
    Preserve=False)
shatter = Shatter(Curve=inverse_bot.Geometry, Parameters=curve_curve.ParamsA)
shatter_2 = Shatter(Curve=inverse_top.Geometry, Parameters=curve_curve_2.ParamsA)
shatter_3 = Shatter(Curve=inverse_right.Geometry, Parameters=curve_curve_2.ParamsA)
shatter_4 = Shatter(Curve=inverse_left.Geometry, Parameters=curve_curve_2.ParamsA)
curve_curve_3 = CurveCurve(CurveA=move_left.Geometry, CurveB=move_rec.Geometry)  # -> Points, ParamsA, ParamsB
shatter_5 = Shatter(Curve=move_left.Geometry, Parameters=curve_curve_3.ParamsA)
list_item = ListItem(List=shatter_5, Index=0, Wrap=True)
curve_curve_4 = CurveCurve(CurveA=move_right.Geometry, CurveB=move_rec.Geometry)  # -> Points, ParamsA, ParamsB
shatter_6 = Shatter(Curve=move_right.Geometry, Parameters=curve_curve_4.ParamsA)
shatter_7 = Shatter(Curve=move_rec.Geometry, Parameters=curve_curve_4.ParamsB)
list_item_2 = ListItem(List=shatter_7, Index=0, Wrap=True)  # -> Item, Item1
list_item_3 = ListItem(List=shatter_6, Index=0, Wrap=True)
list_item_4 = ListItem(List=shatter, Index=0, Wrap=True)
curve = Curve(list_item_2.Item)
curve_2 = Curve(list_item_2.Item1)
list_item_5 = ListItem(List=shatter_2, Index=0, Wrap=True)
vector_xyz_4 = VectorXYZ(XComponent=0, YComponent=0, ZComponent=0)  # -> Vector, Length
shatter_8 = Shatter(Curve=curve)
split = Split(Transform=[curve, curve_2])
split_brep = SplitBrep(Brep=curve_2, Cutter=curve)
move = Move(Motion=vector_xyz_4.Vector)  # -> Geometry, Transform
join_curves_3 = JoinCurves(Curves=shatter_8, Preserve=False)
