# Grasshopper definition class_example.gh (Grasshopper 1.0.7)

polygon_side_length = Slider(41, range=5..50)
cluster = Cluster_3(polygon_side_length=polygon_side_length)
nub_count = Slider(4, range=0..10)
cluster_2 = Cluster_2(polygon_side_length=polygon_side_length)
one = Number(1)
vector_top = VectorXYZ(XPolygonSideLength2=cluster_2, YPolygonSideLength2=cluster, ZComponent=0)  # -> VectorTo, Length
subtraction = Subtraction(NubCount=nub_count, One=one)
cluster_3 = Cluster(nubs=nub_count, nubs_2=subtraction, polygon_side_length=polygon_side_length)
subtraction_2 = Subtraction(PolygonSideLength2=cluster_2, NubWidth=cluster_3)
cluster_4 = Cluster_4(nub_width=cluster_3)
unit_x = UnitX(Factor=cluster_4)
unit_y = UnitY(Factor=cluster_4)
vector_bottom = VectorXYZ(XComponent=cluster_2, YPSL2NW=subtraction_2, ZComponent=0)  # -> Vector, Length
vector_left = VectorXYZ(XPSL2NW=subtraction_2, YComponent=cluster_2, ZComponent=0)  # -> Vector, Length
vector_xyz = VectorXYZ(XComponent=0, YComponent=cluster_3, ZComponent=0)  # -> Vector, Length
vector_xyz_2 = VectorXYZ(XComponent=cluster_3, YComponent=0, ZComponent=0)  # -> Vector, Length
nub = Rectangle(Plane=PlaneXY(0, 0, 0), XSize=cluster_3, YSize=cluster_3, Radius=0)  # -> Rectangle, Length
vector_right = VectorXYZ(XComponent=cluster, YComponent=cluster_2, ZComponent=0)  # -> Vector, Length
linear_array = LinearArray(NubShape=nub.Rectangle, Direction=unit_x, NubCount=subtraction)  # -> HorizontalNubShape, Transform
linear_array_2 = LinearArray(NubShape=nub.Rectangle, YUnitVector=unit_y, NubCount=subtraction)  # -> VerticalNubShape, Transform

inverse_side = Move(HorizontalNubShape=linear_array.HorizontalNubShape, MoveRightOne=vector_xyz_2.Vector)  # -> HorizontalNubShape, Transform
inverse_up = Move(VerticalNubShape=linear_array_2.VerticalNubShape, MoveUpOne=vector_xyz.Vector)  # -> VerticalNubShape, Transform
side_side = LinearArray(NubShape=nub.Rectangle, XUnitVector=unit_x, NubCount=nub_count)  # -> HorizontalNubShape, Transform
up_down = LinearArray(NubShape=nub.Rectangle, YUnitVector=unit_y, NubCount=nub_count)  # -> VerticalNubShape, Transform

move_right = Move(VerticalNubCount=up_down.VerticalNubShape, MoveToRight=vector_right.Vector)  # -> VerticalRightNubShape, Transform
inverse_bot = Move(HorizontalNubShape=inverse_side.HorizontalNubShape, MoveToBottom=vector_bottom.Vector)  # -> BottomNubShape, Transform
move_bot = Move(HorizontalNubShape=side_side.HorizontalNubShape, MoveToBottom=vector_bottom.Vector)  # -> BottomNubShape, Transform
move_top = Move(HorizontalNubShape=side_side.HorizontalNubShape, MoveToTop=vector_top.VectorTo)  # -> TopNubShape, Transform
inverse_top = Move(HorizontalNubShape=inverse_side.HorizontalNubShape, MoveToTop=vector_top.VectorTo)  # -> TopNubTop, Transform
inverse_right = Move(VerticalRightNub=inverse_up.VerticalNubShape, MoveToRight=vector_right.Vector)  # -> RightNubShape, Transform
move_left = Move(VerticalNubShape=up_down.VerticalNubShape, MoveToLeft=vector_left.Vector)  # -> LeftNubShape, Transform
inverse_left = Move(VerticalNubShape=inverse_up.VerticalNubShape, MoveToLeft=vector_left.Vector)  # -> LeftNub, Transform
cluster_5 = Cluster_5(x_size=polygon_side_length, y_size=polygon_side_length, polygon_side_length=polygon_side_length)

trim_with_regions = TrimWithRegions(
    Curve=[move_right.VerticalRightNubShape, move_top.TopNubShape, move_left.LeftNubShape, move_bot.BottomNubShape],
    Regions=cluster_5)  # -> Inside, Outside
join_curves = JoinCurves(
    Curves=[inverse_right.RightNubShape, inverse_left.LeftNub, inverse_bot.BottomNubShape, inverse_top.TopNubTop, cluster_5],
    Preserve=False)
join_curves_2 = JoinCurves(Curves=trim_with_regions.Outside, Preserve=False)
trim_with_regions_2 = TrimWithRegions()  # -> Inside, Outside
trim_with_region = TrimWithRegion(Curve=trim_with_regions_2.Inside)  # -> Inside, Outside

# ==== cluster Cluster
polygon_side_length = ClusterInput()
nubs = ClusterInput()
nubs_2 = ClusterInput()
addition = Addition(Nubs=nubs, Nubs_2=nubs_2)
division = Division(PolygonSideLength=polygon_side_length, TotalNubsPerSide=addition)
nub_width = ClusterOutput(division)

# ==== cluster Cluster_2
polygon_side_length = ClusterInput()
negative_two = Number(-2)
division = Division(PolygonSideLength=polygon_side_length, Negative2=negative_two)
result = ClusterOutput(division)

# ==== cluster Cluster_3
two = Number(2)
polygon_side_length = ClusterInput()
division = Division(PolygonSideLength=polygon_side_length, Two=two)
polygon_side_length_2 = ClusterOutput(division)

# ==== cluster Cluster_4
nub_width = ClusterInput()
two = Number(2)
multiplication = Multiplication(NubWidth=nub_width, Two=two)
result = ClusterOutput(multiplication)

# ==== cluster Cluster_5
polygon_side_length = ClusterInput()
negative_two = Number(-2)
division = Division(PolygonSideLength=polygon_side_length, Negative2=negative_two)
x_size = ClusterInput()
y_size = ClusterInput()
rectangle = Rectangle(Plane=PlaneXY(0, 0, 0), XSize=x_size, YSize=y_size, Radius=0)  # -> Rectangle, Length
vector_xyz = VectorXYZ(XComponent=division, YComponent=division, ZComponent=0)  # -> Vector, Length
move_rec = Move(Geometry=rectangle.Rectangle, Motion=vector_xyz.Vector)  # -> Geometry, Transform
geometry = ClusterOutput(move_rec.Geometry)
