# Grasshopper definition final [Dec-02 '22, 1615].gh (Grasshopper 1.0.7)

rect_width = Slider(4, range=0..5)
square = Square(Value=rect_width)
circle_rad = Slider(60, range=0..100)
square_2 = Square(Radius=circle_rad)
rect_hight = Slider(15, range=0..100)
division = Division(RectWidth=rect_width, Two=2)
negative_two = Number(-2)
division_2 = Division(A=rect_width, B=negative_two)
division_3 = Division(W2=square, B=4)
division_4 = Division(W2=division, Radius=circle_rad)
square_3 = Square(CircleRad=circle_rad)
subtraction = Subtraction(R2=square_2, B=division_3)
subtraction_2 = Subtraction(A=circle_rad, B=rect_hight)
square_4 = Square(Value=division_2)
arctangent = ArcTangent(Value=division_4)
rectangle = Rectangle(Plane=PlaneXY(0, 0, 0), XSize=rect_width, YSize=rect_hight, Radius=0)  # -> Rectangle, Length
vector_xyz = VectorXYZ(XComponent=division_2, YComponent=subtraction_2, ZComponent=0)  # -> Vector, Length
square_root = SquareRoot(Value=subtraction)
multiplication = Multiplication(A=circle_rad, B=2)
subtraction_3 = Subtraction(A=square_3, B=square_4)
addition = Addition(A=division_2, RectWidth=rect_width)
division_5 = Division(A=multiplication, _2=-2)
rectangle_2 = Rectangle(Plane=PlaneXY(0, 0, 0), XSize=multiplication, YSize=multiplication, Radius=0)  # -> Rectangle, Length
subtraction_4 = Subtraction(Radius=circle_rad, R2W24=square_root)
square_root_2 = SquareRoot(Value=subtraction_3)
circle_center = Point(Point(0, 0, 0))
number_of_sides = Slider(5, range=0..10)
division_6 = Division(_2pi=6.283185307, NumberOfSides=number_of_sides)
subtraction_5 = Subtraction(Pi2=1.570796327, _2piS=division_6)
move = Move(Geometry=rectangle.Rectangle, Motion=vector_xyz.Vector)  # -> Geometry, Transform
vector_xyz_2 = VectorXYZ(XComponent=division_5, YComponent=division_5, ZComponent=0)  # -> Vector, Length
square_5 = Square(Value=division)
square_6 = Square(Value=subtraction_4)
circle_cnr = CircleCNR(Center=circle_center, Normal=Vector(0, 0, 1), Radius=circle_rad)
addition_2 = Addition(B2=square_6, W22=square_5)
construct_point = ConstructPoint(XCoordinate=addition, YCoordinate=square_root_2, ZCoordinate=0)
move_2 = Move(Geometry=rectangle_2.Rectangle, Motion=vector_xyz_2.Vector)  # -> Geometry, Transform
square_root_3 = SquareRoot(Value=addition_2)
division_7 = Division(A=square_root_3, B=2)
count = Slider(50, range=0..50)
seed = Slider(3, range=0..10)
division_8 = Division(C2=division_7, Radius=circle_rad)
arcsine = ArcSine(Value=division_8)
surface = Surface(<surface referenced from the Rhino model>)
multiplication_2 = Multiplication(ArcsinC=arcsine, B=2)
addition_3 = Addition(A=subtraction_5, B=multiplication_2)
cosine = Cosine(Value=addition_3)
sine = Sine(Value=addition_3)
multiplication_3 = Multiplication(Radius=circle_rad, CosNa=cosine)
multiplication_4 = Multiplication(Radius=circle_rad, SinNa=sine)
construct_point_2 = ConstructPoint(XCoordinate=multiplication_3, YCoordinate=multiplication_4, ZCoordinate=0)
line = Line(StartPoint=construct_point, EndPoint=construct_point_2)
polar_array = PolarArray(Geometry=[move.Geometry, line], Plane=PlaneXY(0, 0, 0), Count=number_of_sides, Angle=6.283185307)  # -> Geometry, Transform
trim_with_regions = TrimWithRegions(Curve=polar_array.Geometry, Regions=circle_cnr)  # -> Inside, Outside
join_curves = JoinCurves(Curves=trim_with_regions.Inside, Preserve=False)
populate_geometry = PopulateGeometry(Geometry=surface, Count=count, Seed=seed)
divide_curve = DivideCurve(Curve=join_curves, Count=Slider(4, range=0..10), Kinks=False)  # -> Points, Tangents, Parameters
offset_curve = OffsetCurve(Distance=-3, Corners=1)
set_union = SetUnion(SetA=divide_curve.Points, SetB=populate_geometry)
cluster = Cluster()
voronoi = Voronoi(Points=populate_geometry, Radius=surface, BruteForceOverride=False)
control_point_loft = ControlPointLoft(Degree=5)
degree = Slider(2, range=1..3)
deconstruct_brep = DeconstructBrep(Brep=voronoi)  # -> Faces, Edges, Vertices
extrude = Extrude()  # -> reverse(Extrusion)
nurbs_curve = NurbsCurve(Vertices=deconstruct_brep.Vertices, Degree=degree, Periodic=Toggle(True))  # -> Curve, Length, Domain
area = Area(Geometry=nurbs_curve.Curve)  # -> Area, Centroid
scale = Scale(Geometry=nurbs_curve.Curve, Center=area.Centroid, Factor=Slider(0.7, range=0..1))  # -> Geometry, Transform
surface_split = SurfaceSplit(Surface=deconstruct_brep.Faces, Curves=scale.Geometry)
simplify_curve = SimplifyCurve()  # -> Curve, Simplified
list_item = ListItem(List=surface_split, Index=0, Wrap=True)
unit_z = UnitZ(Factor=Slider(1.5, range=0..10))
surface_2 = Surface(list_item)
extrude_2 = Extrude(Base=surface_2, Direction=unit_z)
curve = Curve(join_curves)
brep = Brep(voronoi)

# ==== cluster Cluster
seed = Slider(7, range=0..10)
count = Slider(45, range=0..50)
populate_2d = Populate2D(Region={Plane=PlaneXY(0, 0, 0), Size=Domain2(u=0..20, v=0..10)}, Count=count, Seed=seed)
voronoi = Voronoi(Points=populate_2d, BruteForceOverride=False)
degree = Slider(2, range=1..3)
deconstruct_brep = DeconstructBrep(Brep=voronoi)  # -> Faces, Edges, Vertices
nurbs_curve = NurbsCurve(Vertices=deconstruct_brep.Vertices, Degree=degree, Periodic=Toggle(True))  # -> Curve, Length, Domain
area = Area(Geometry=nurbs_curve.Curve)  # -> Area, Centroid
scale = Scale(Geometry=nurbs_curve.Curve, Center=area.Centroid, Factor=Slider(0.9, range=0..1))  # -> Geometry, Transform
surface_split = SurfaceSplit(Surface=deconstruct_brep.Faces, Curves=scale.Geometry)
negative = Negative(Value=Slider(0.5, range=0..1))
unit_z = UnitZ(Factor=negative)
list_item = ListItem(List=surface_split, Index=0, Wrap=True)
extrude = Extrude(Base=list_item, Direction=unit_z)  # -> reverse(Extrusion)
